% Simulink data dictionary data_params.sldd

Sig = Simulink.Signal()

Cond = struct(
  area_core_chassis=0.04,
  thick_core_chassis=0.005,
  k_core_chassis=150,
  area_chassis_rad=0.008,
  thick_chassis_rad=0.2,
  k_chassis_rad=150)

Constant = struct(T_moon_K=220, angle_sun_deg=88.5, sigma=5.67e-8, k_aluminum=150)
Area = struct(front=0.12, back=0.12, top=0.05, bottom=0.24, left=0.18, right=0.18, rad=0.24)

Spec = struct(
  alpha_rad=0.15,
  epsilon_rad=0.85,
  mass_rad_kg=0.5,
  cp_rad_J_kgK=897,
  mass_chassis_kg=25,
  cp_chassis_J_kgK=897,
  mass_electronics_kg=3,
  cp_electronics_J_kgK=1000,
  alpha_mli=0.35,
  epsilon_mli=0.85,
  mass_mli=1.5,
  cp_mli_J_kgK=1000,
  epsilon_eff_leak_mli=0.03)